# Grasshopper definition HelloWorld.ghx (Grasshopper 1.0.8)

name = GetString(AtLeast=1, AtMost=1, Prompt="Provide a name:", TreeAccess=False)
concat = Concatenate(FragmentA="Hello ", FragmentB=name, FragmentC="!")
context_bake = ContextBake(Content=concat)
